# Dynamo graph PocOutput.dyn (Dynamo 3.3.0.6316)

file_path = Filename("E:\LatencyMetrics.csv")
loadExchangeDataFromCSV = DynomaoPOC.Class1.LoadExchangeDataFromCSV(filePath=file_path)
aggregateData = DynomaoPOC.Class1.AggregateData(data=loadExchangeDataFromCSV)
watch = Watch(aggregateData)
